# Grasshopper definition rhinoPlot.gh (Grasshopper 1.0.7)
# plug-ins: Geospatial, LunchBoxML

path = FilePath("E:\PythonFile\testFile\NetworkX_test\originalData\fileExport\newBlockResult_BT+CL.geojson")
path_2 = FilePath("E:\PythonFile\testFile\NetworkX_test\originalData\road_BT+CL.geojson")

# ---- group: road
crv = Curve([<curve referenced from the Rhino model> x541])  # disabled

# ---- group: block
crv_2 = Curve([<curve referenced from the Rhino model> x497])  # disabled

# ----
readjson = ReadGeoJSON(File=path)  # -> Type, Geometry, Keys, Values
readjson_2 = ReadGeoJSON(File=path_2)  # -> Type, Geometry, Keys, Values
item = ListItem(List=readjson_2.Values, Index=0, Wrap=True)  # -> Item, flatten(Item1)
lines = FeatureFromLines(Curves=graft(crv))  # disabled
polygons = FeatureFromPolygons(Polygons=graft(crv_2))  # disabled
bang = ExplodeTree(Data=readjson_2.Keys)
boundary = BoundarySurfaces(Edges=readjson.Geometry)
panel = Panel("E:\PythonFile\testFile\NetworkX_test\originalData\fileExport")  # disabled
bnd = Bounds(Numbers=item.Item1)
remap = RemapNumbers(Value=item.Item1, Source=bnd, Target=Domain(0, 1))  # -> Mapped, Clipped
panel_2 = Panel("E:\PythonFile\testFile\NetworkX_test\originalData\fileExport")  # disabled
join = JoinGeoJSON(Features=flatten(lines))  # disabled
data = Data(flatten(boundary))
join_2 = JoinGeoJSON(Features=flatten(polygons))  # disabled
data_2 = Data(flatten(readjson_2.Geometry))
data_3 = Data(flatten(readjson_2.Values))
toggle = BooleanToggle(False)  # disabled
gradient = Gradient(LowerLimit=0, UpperLimit=1, Parameter=remap.Mapped, stops=[0: RGB(0, 128, 0), 0.5: RGB(255, 255, 0), 1: RGB(255, 0, 0)])
bbox = BoundingBox(Content=data, Plane=PlaneXY(0, 0, 0))  # -> Box, Box_2
panel_3 = Panel("road.geojson")  # disabled
toggle_2 = BooleanToggle(False)  # disabled
explode = Explode(Curve=data, Recursive=True)  # -> Segments, Vertices
panel_4 = Panel("block.geojson")  # disabled
debrep = DeconstructBrep(Brep=bbox.Box)  # -> Faces, Edges, Vertices
midpt = CurveMiddle(Curve=data_2)
write_file = WriteFile(Directory=panel, Filename=panel_3, Data=join, Run=toggle, Overwrite=toggle)  # disabled
item_2 = ListItem(List=readjson.Values, Index=0, Wrap=True)  # -> flatten(Item), flatten(Item1)
write_file_2 = WriteFile(Directory=panel_2, Filename=panel_4, Data=join_2, Run=toggle_2, Overwrite=toggle_2)  # disabled
midpt_2 = CurveMiddle(Curve=explode.Segments)
midpt_3 = CurveMiddle(Curve=debrep.Edges)
preview = CustomPreview(Geometry=data_2, Material=gradient)
tag = TextTag3D(Location=midpt, Text=data_3, Size="30", Colour=ColourSwatch(SwatchColor=RGB(255, 255, 255)), Justification=7)
rtree = CreateRTree(InputGeometry=midpt)
rtree_cp = RTreeClosestPoint(SearchPoints=midpt_2, RTree=rtree)  # -> ClosestPoint, ClosestIndex
data_4 = Data(item_2.Item1)
panel_5 = Panel(item_2.Item)
bnd_2 = Bounds(Numbers=data_4)
remap_2 = RemapNumbers(Value=data_4, Source=bnd_2, Target=Domain(0, 1))  # -> Mapped, Clipped
item_3 = ListItem(List=data_3, Index=rtree_cp.ClosestIndex, Wrap=True)
ma = MassAddition(Input=item_3)  # -> flatten(Result), PartialResults
gradient_2 = Gradient(
    LowerLimit=0,
    UpperLimit=1,
    Parameter=remap_2.Mapped,
    stops=[0: RGB(0, 128, 0), 0.43: RGB(255, 255, 0), 1: RGB(255, 0, 0)])
data_5 = Data(flatten(readjson.Values))
item_4 = ListItem(List=data_5, Index=0, Wrap=True)
preview_2 = CustomPreview(Geometry=data, Material=gradient_2)
panel_6 = Panel(ma.Result)
